# Grasshopper definition tower.gh (Grasshopper 1.0.8)

point = Point(<point referenced from the Rhino model>)
number_slider = Slider(6, range=0..200)
circle_cnr = CircleCNR(Center=point, Normal=Vector(0, 0, 1), Radius=Slider(83, range=0..1600))
divide_curve = DivideCurve(Curve=circle_cnr, Count=number_slider, Kinks=False)  # -> Points, Tangents, Parameters
unit_z = UnitZ(Factor=1)
vector_2pt = Vector2Pt(PointA=point, PointB=divide_curve.Points, Unitize=False)  # -> Vector, Length
vector_display = VectorDisplay(Anchor=point, Vector=vector_2pt.Vector)
move = Move(Geometry=divide_curve.Points, Motion=vector_2pt.Vector)  # -> Geometry, Transform
unit_z_2 = UnitZ(Factor=1)
radians = Radians(Degrees=Slider(90, range=0..180))
rotate = Rotate(Vector=vector_2pt.Vector, Axis=unit_z_2, Angle=radians)
move_2 = Move(Geometry=divide_curve.Points, Motion=rotate)  # -> Geometry, Transform
vector_display_2 = VectorDisplay(Anchor=divide_curve.Points, Vector=rotate)
number_slider_2 = Slider(19, range=0..100)
plane_3pt = Plane3Pt(PointA=divide_curve.Points, PointB=move.Geometry, PointC=move_2.Geometry)
division = Division(A=Slider(65, range=0..100), B=2)
division_2 = Division(A=Slider(35, range=0..100), B=2)
number_slider_3 = Slider(11, range=0..100)
addition = Addition(A=number_slider_2, B=0)
division_3 = Division(A=number_slider_2, B=2)
addition_2 = Addition(A=number_slider_2)
number = Number(number_slider)
number_slider_4 = Slider(4, range=0..50)
addition_3 = Addition(A=number_slider_4)
multiplication = Multiplication(A=number_slider_2, B=addition_3)
unit_z_3 = UnitZ(Factor=multiplication)
move_3 = Move(Geometry=plane_3pt, Motion=unit_z_3)  # -> Geometry, Transform
division_4 = Division(A=360, B=number)
unit_z_4 = UnitZ(Factor=addition)
center_box = CenterBox(Base=plane_3pt, X=division_2, Y=division, Z=division_3)
series = Series(Start=0, Step=addition_2, Count=number_slider_3)
division_5 = Division(A=180, B=number_slider_3)
dispatch = Dispatch(List=move_3.Geometry, DispatchPattern=[True, False])  # -> ListA, ListB
division_6 = Division(A=division_4, B=2)
unit_z_5 = UnitZ(Factor=series)
series_2 = Series(Start=0, Step=division_6, Count=number_slider_4)
multiplication_2 = Multiplication(A=division_5, B=-1)
graft_tree = GraftTree(Tree=dispatch.ListB, IncludeEmptyLists=True, IncludeNullItems=True)
graft_tree_2 = GraftTree(Tree=dispatch.ListA, IncludeEmptyLists=True, IncludeNullItems=True)
linear_array = LinearArray(Geometry=center_box, Direction=unit_z_4, Count=number_slider_4)  # -> Geometry, Transform
radians_2 = Radians(Degrees=series_2)
move_4 = Move(Geometry=graft_tree_2, Motion=unit_z_5)  # -> Geometry, Transform
series_3 = Series(Start=0, Step=multiplication_2, Count=number_slider_3)
move_5 = Move(Geometry=graft_tree, Motion=unit_z_5)  # -> Geometry, Transform
series_4 = Series(Start=0, Step=division_5, Count=number_slider_3)
radians_3 = Radians(Degrees=series_4)
rotate_2 = Rotate(Geometry=linear_array.Geometry, Angle=radians_2, Plane=PlaneXY(0, 0, 0))  # -> Geometry, Transform
radians_4 = Radians(Degrees=series_3)
rotate_3 = Rotate(Geometry=move_4.Geometry, Angle=radians_3, Plane=move_4.Geometry)  # -> Geometry, Transform
rotate_4 = Rotate(Geometry=move_5.Geometry, Angle=radians_4, Plane=move_5.Geometry)  # -> Geometry, Transform
center_box_2 = CenterBox(Base=rotate_3.Geometry, X=division_2, Y=division, Z=division_3)
center_box_3 = CenterBox(Base=rotate_4.Geometry, X=division_2, Y=division, Z=division_3)
merge = Merge(Data1=center_box_2, Data2=center_box_3)
group = Group(Geometry=rotate_2.Geometry)
group_2 = Group(Geometry=merge)
addition_4 = Addition(A=number_slider_4, B=number_slider_3)
multiplication_3 = Multiplication(A=addition_4, B=19)
merge_2 = Merge(Data1=group, Data2=group_2)
unit_z_6 = UnitZ(Factor=multiplication_3)
linear_array_2 = LinearArray(Geometry=merge_2, Direction=unit_z_6, Count=4)  # -> Geometry, Transform
